% Simulink data dictionary bms_data.sldd

BMS_PlantTruth = Simulink.Bus()
  SOC_pct: double, Unit="percent"  % True state of charge
  Voltage_V: double, Unit="V"  % True terminal voltage
  Temperature_K: double, Unit="K"  % True cell temperature

BMS_Measurement = Simulink.Bus()
  Voltage_V: double, Unit="V"  % Measured terminal voltage
  Current_A: double, Unit="A"  % Measured current, positive when discharging
  Temperature_K: double, Unit="K"  % Measured cell temperature

BMS_Estimate = Simulink.Bus()
  SOC_pct: double, Unit="percent"  % Estimated state of charge
  Voltage_V: double, Unit="V"  % Predicted terminal voltage (before the correction)
  Innovation_V: double, Unit="V"  % Measured minus predicted voltage
  PTrace: double  % Trace of the state covariance matrix
  NIS: double  % Normalised innovation squared, expected near 1
  FaultCode: double  % Diagnostic bit mask: 1 V range, 2 T range, 4 I range, 8 rejected, 16 inconsistent
  R0_Ohm: double, Unit="ohm"  % Ohmic resistance used by the model
  SOC_Coulomb_pct: double, Unit="percent"  % Coulomb-counting baseline SOC
  R_cov_V2: double  % Measurement-noise variance used by the filter
  CapacityRatio: double  % Estimated capacity divided by nominal capacity

BMS_Reference = Simulink.Bus()
  SOC_pct: double, Unit="percent"  % Reference state of charge
  Source_Tag: double  % Source tag (0: SIM, 1: REPLAY)

BMS_Q = Simulink.Parameter([1.0e-9; 1.0e-9; 1.533887e-7], DataType="double")  % Process-noise variances [SOC; V1; V2], ACO-tuned, simulated cell
BMS_R = Simulink.Parameter(0.001474701, DataType="double")  % Voltage measurement-noise variance, ACO-tuned, simulated cell
NASA_Q = Simulink.Parameter([5.860785e-7; 9.939686e-5; 0.0001], DataType="double")  % Process-noise variances [SOC; V1; V2], ACO-tuned, NASA-calibrated cell
NASA_R = Simulink.Parameter(0.009881778, DataType="double")  % Voltage measurement-noise variance, ACO-tuned, NASA-calibrated cell